# Grasshopper definition assignment-01.gh (Grasshopper 1.0.9)

# Assignment-01: Bauhaus
number_slider = Slider(2, range=1..4)
py3 = Python3Script(
    tower_count=number_slider,
    spacing_mult=Slider(1.25, range=1.05..10),
    bridge_z=Slider(48, range=0..100),
    cantilever_len=Slider(20, range=1..20),
    cylinder_radius=Slider(17.477, range=1..20),
    cylinder_z_center=Slider(0, range=0..20))  # -> out, towers, bridge, arch_void
# ---------- py3: Python ----------
"""
Bauhaus-style composition inspired by Marina Bay Sands
GhPython component (Rhino 7/8, rhinoscriptsyntax)

INPUTS  (set Type Hints on the component):
    tower_count       : int    - number of vertical towers
    spacing_mult      : float  - multiplier on X pitch between towers
    bridge_z          : float  - Z elevation of the bridge underside
    cantilever_len    : float  - X overhang of bridge past outer towers
    cylinder_radius   : float  - radius of the arch-void cylinder
    cylinder_z_center : float  - Z elevation of the cylinder axis

OUTPUTS:
    towers    : list of Breps (closed boxes)
    bridge    : Brep (closed box)
    arch_void : Brep (closed, capped cylinder) -> feed into Solid Difference
"""

import rhinoscriptsyntax as rs

# ---------------------------------------------------------------------------
# 0. Input guards / defaults (GH passes None for unconnected inputs)
# ---------------------------------------------------------------------------
def _val(v, default):
    return default if v is None else v

n          = max(1, int(_val(tower_count, 3)))
s_mult     = max(1.05, float(_val(spacing_mult, 1.6)))   # <1.05 would make towers collide
b_z        = max(1.0, float(_val(bridge_z, 120.0)))
cant       = max(0.0, float(_val(cantilever_len, 40.0)))
cyl_r      = max(0.1, float(_val(cylinder_radius, 35.0)))
cyl_zc     = float(_val(cylinder_z_center, 0.0))

# ---------------------------------------------------------------------------
# Fixed design constants
# ---------------------------------------------------------------------------
BASE_W          = 40.0      # base tower width  (X)
BASE_D          = 30.0      # base tower depth  (Y)
TARGET_VOLUME   = 60000.0   # nominal constant volume per tower
BRIDGE_THICK    = 8.0       # bridge slab thickness (Z)
PIERCE_MARGIN   = 15.0      # how far the tallest tower rises above the bridge top
CYL_OVERSHOOT   = 2.0       # cylinder extends past Y-depth -> clean Boolean, no coplanar faces

# Modulo lookup tables - different cycle lengths (3 vs 4) give a
# non-repeating, asymmetrical rhythm along the row.
W_FACTORS = [1.00, 1.35, 0.70]
D_FACTORS = [1.00, 0.70, 1.25, 0.90]


def box_from_bounds(x0, y0, z0, x1, y1, z1):
    """Axis-aligned closed box from min/max bounds -> Brep."""
    corners = [
        (x0, y0, z0), (x1, y0, z0), (x1, y1, z0), (x0, y1, z0),
        (x0, y0, z1), (x1, y0, z1), (x1, y1, z1), (x0, y1, z1),
    ]
    gid = rs.AddBox(corners)
    return rs.coercebrep(gid)


# ---------------------------------------------------------------------------
# 1. Asymmetrical towers - footprint via modulo, height = V / (w * d)
# ---------------------------------------------------------------------------
footprints = []
for i in range(n):
    w = BASE_W * W_FACTORS[i % len(W_FACTORS)]
    d = BASE_D * D_FACTORS[i % len(D_FACTORS)]
    footprints.append((w, d))

raw_heights = [TARGET_VOLUME / (w * d) for (w, d) in footprints]

# Enforce the two structural rules with ONE uniform scale factor k, so the
# volume stays identical across every tower (V' = k * V for all of them):
#   a) tallest tower pierces the bridge:  k * h_max > bridge top + margin
#   b) shortest tower still reaches the bridge underside: k * h_min >= bridge_z
bridge_top = b_z + BRIDGE_THICK
k = max(1.0,
        (bridge_top + PIERCE_MARGIN) / max(raw_heights),
        b_z / min(raw_heights))
heights = [h * k for h in raw_heights]
effective_volume = TARGET_VOLUME * k   # constant per-tower volume actually used

# X layout: uniform pitch based on the widest footprint, centered on origin
max_w = max(w for (w, d) in footprints)
pitch = s_mult * max_w
x_centers = [(i - (n - 1) / 2.0) * pitch for i in range(n)]

towers = []
for (w, d), h, xc in zip(footprints, heights, x_centers):
    towers.append(box_from_bounds(xc - w / 2.0, -d / 2.0, 0.0,
                                  xc + w / 2.0,  d / 2.0, h))

# Overall composition extents
x_min_towers = min(xc - w / 2.0 for (w, d), xc in zip(footprints, x_centers))
x_max_towers = max(xc + w / 2.0 for (w, d), xc in zip(footprints, x_centers))
max_d = max(d for (w, d) in footprints)
y_min, y_max = -max_d / 2.0, max_d / 2.0

# ---------------------------------------------------------------------------
# 2. Intersecting bridge - spans outer towers + cantilever each side
# ---------------------------------------------------------------------------
bx0 = x_min_towers - cant
bx1 = x_max_towers + cant
bridge = box_from_bounds(bx0, y_min, b_z, bx1, y_max, bridge_top)

# ---------------------------------------------------------------------------
# 3. Negative arch - horizontal cylinder along +Y, centered on X span
# ---------------------------------------------------------------------------
x_mid = (bx0 + bx1) / 2.0                   # midpoint of full X span
y_start = y_min - CYL_OVERSHOOT
cyl_len = (y_max - y_min) + 2.0 * CYL_OVERSHOOT

cyl_plane = rs.PlaneFromNormal((x_mid, y_start, cyl_zc), (0, 1, 0))
cyl_id = rs.AddCylinder(cyl_plane, cyl_len, cyl_r, cap=True)
arch_void = rs.coercebrep(cyl_id)

# Diagnostic printout (visible on the component's 'out' parameter)
print("Towers: {}  |  pitch: {:.2f}".format(n, pitch))
print("Constant tower volume: {:.1f}  (scale k = {:.3f})".format(effective_volume, k))
print("Heights: " + ", ".join("{:.1f}".format(h) for h in heights))
print("Bridge X: {:.1f} -> {:.1f}  |  top Z: {:.1f}".format(bx0, bx1, bridge_top))
print("Tallest tower pierces bridge by {:.1f}".format(max(heights) - bridge_top))
# ---------- end py3 ----------
sunion = SolidUnion(Breps=flatten([py3.bridge, py3.towers]))
panel = Panel(py3.out)
sdiff = SolidDifference(BrepsA=sunion, BrepsB=py3.arch_void)
